# Dynamo graph GeoTop-Grupo3.dyn (Dynamo 3.7.0.11777)
# author: ingelver gonzales
# script para colocar elementos en revit con coordenadas utm

n01_levantamiento = Filename("C:\Users\LENOVO\Downloads\Levantamiento Pozo Tierras.xlsx")  # "01-Levantamiento"; graph input
n02_hoja = StringInput("")  # "02-Hoja"; graph input
n03_familia = FamilyTypes("Punto Control Orden C:Punto Control Orden C")  # "03-Familia"; graph input
verificaciones = BoolSelector(true)
python_script = Python(IN[0]=n01_levantamiento, IN[1]=n02_hoja, IN[2]=n03_familia, IN[3]=verificaciones)  # CPython3
# ---------- python_script.python (611 lines) ----------
"""
COLOCACIÓN DE FAMILIAS DESDE EXCEL
Revit 2025-2026

Grupo 3:
Dilver Llajaruna Anticona.
Jimmy Loli Mendoza.
Ingelver Gonzales Escobar.

ESTRUCTURA DE EXCEL
Este, Norte, Cota.

PROBLEMA
Cuando estamos en la etapa de construcción muchas veces se tiene que colocar elementos o interferencias que no fueron considerados al momento del expediente y es cuando topografía realiza el levantamiento y es donde el área de diseño tiene que colocar eso en el modelo digital para tomar decisiones. Es por ella nace el pequeño script.
01-Levantamiento; Selección de archivo Excel, levantamiento.
02-Hoja; si tiene varias hojas se coloca el nombre si no se deja en blanco.
03-Familia; Se escoge la familia existente o cargada en el modelo. 
"""

import clr
import math
import posixpath
import zipfile
import xml.etree.ElementTree as ET

clr.AddReference("RevitAPI")
clr.AddReference("RevitAPIUI")
clr.AddReference("RevitServices")
clr.AddReference("RevitNodes")

import Revit
clr.ImportExtensions(Revit.Elements)

from Autodesk.Revit.DB import (
    XYZ,
    UnitUtils,
    UnitTypeId,
    FamilySymbol,
    FamilyPlacementType,
    FamilyInstance,
    FilteredElementCollector,
    SubTransaction,
    TransactionStatus,
    LocationPoint
)

from Autodesk.Revit.DB.Structure import StructuralType
from Autodesk.Revit.UI import TaskDialog
from RevitServices.Persistence import DocumentManager
from RevitServices.Transactions import TransactionManager

doc = DocumentManager.Instance.CurrentDBDocument

NS = {
    "s": "http://schemas.openxmlformats.org/spreadsheetml/2006/main"
}


def leer_excel(ruta, nombre_hoja):
    with zipfile.ZipFile(ruta, "r") as archivo:
        textos = []

        if "xl/sharedStrings.xml" in archivo.namelist():
            raiz = ET.fromstring(
                archivo.read("xl/sharedStrings.xml")
            )
            textos = [
                "".join(
                    nodo.text or ""
                    for nodo in elemento.iterfind(".//s:t", NS)
                )
                for elemento in raiz
            ]

        libro = ET.fromstring(
            archivo.read("xl/workbook.xml")
        )
        hojas = libro.find("s:sheets", NS)

        if hojas is None or len(hojas) == 0:
            raise ValueError("El Excel no contiene hojas.")

        hoja = (
            next(
                (
                    h for h in hojas
                    if h.attrib["name"] == nombre_hoja
                ),
                None
            )
            if nombre_hoja else hojas[0]
        )

        if hoja is None:
            raise ValueError(
                "Hoja inexistente: {}. Disponibles: {}".format(
                    nombre_hoja,
                    ", ".join(h.attrib["name"] for h in hojas)
                )
            )

        identificador = hoja.attrib[
            "{http://schemas.openxmlformats.org/"
            "officeDocument/2006/relationships}id"
        ]

        relaciones = ET.fromstring(
            archivo.read("xl/_rels/workbook.xml.rels")
        )

        destino = next(
            relacion.attrib["Target"]
            for relacion in relaciones
            if relacion.attrib["Id"] == identificador
        )

        destino = (
            destino.lstrip("/")
            if destino.startswith("/")
            else posixpath.normpath("xl/" + destino)
        )

        datos = ET.fromstring(archivo.read(destino))
        filas = []

        for fila in datos.findall(".//s:sheetData/s:row", NS):
            celdas = {}

            for celda in fila.findall("s:c", NS):
                referencia = celda.attrib["r"]
                columna = "".join(
                    caracter for caracter in referencia
                    if caracter.isalpha()
                )

                nodo_valor = celda.find("s:v", NS)
                valor = (
                    nodo_valor.text or ""
                    if nodo_valor is not None else ""
                )
                tipo = celda.attrib.get("t", "")

                if tipo == "s":
                    valor = textos[int(valor)]

                elif tipo == "inlineStr":
                    valor = "".join(
                        nodo.text or ""
                        for nodo in celda.findall(".//s:t", NS)
                    )

                if (
                    celda.find("s:f", NS) is not None
                    and valor == ""
                ):
                    raise ValueError(
                        "Formula sin resultado guardado en {}. "
                        "Recalcule y guarde desde Excel.".format(
                            referencia
                        )
                    )

                celdas[columna] = valor

            if any(str(v).strip() for v in celdas.values()):
                filas.append((int(fila.attrib["r"]), celdas))

        return hoja.attrib["name"], filas


def numero(valor):
    texto = (
        str(valor).strip()
        .replace("\u00a0", "")
        .replace(" ", "")
    )

    if not texto:
        raise ValueError("Coordenada vacia.")

    if "," in texto and "." in texto:
        raise ValueError(
            "Use celdas numericas o texto sin "
            "separadores de miles: " + texto
        )

    resultado = float(texto.replace(",", "."))

    if not math.isfinite(resultado):
        raise ValueError("Coordenada no finita.")

    return resultado


def a_internas(valor):
    return UnitUtils.ConvertToInternalUnits(
        float(valor), UnitTypeId.Meters
    )


def a_metros(valor):
    return UnitUtils.ConvertFromInternalUnits(
        float(valor), UnitTypeId.Meters
    )


def ejecutar():
    if len(IN) < 4:
        raise ValueError(
            "Configure cuatro entradas: IN[0] a IN[3]."
        )

    if doc is None or doc.IsFamilyDocument:
        raise ValueError(
            "Abra un proyecto Revit, no el editor de familias."
        )

    ruta = str(IN[0] or "").strip()
    nombre_hoja = str(IN[1] or "").strip()
    familia = UnwrapElement(IN[2])

    if not isinstance(IN[3], bool):
        raise ValueError("Conecte un nodo Boolean a IN[3].")

    colocar = IN[3]

    if not ruta:
        raise ValueError(
            "Seleccione el Excel mediante File Path."
        )

    if not ruta.lower().endswith(".xlsx"):
        raise ValueError("El archivo debe ser .xlsx.")

    if not isinstance(familia, FamilySymbol):
        raise ValueError(
            "Seleccione un tipo mediante Family Types."
        )

    if not familia.Document.Equals(doc):
        raise ValueError(
            "La familia debe pertenecer al documento activo."
        )

    if (
        familia.Family.FamilyPlacementType
        != FamilyPlacementType.OneLevelBased
    ):
        raise ValueError(
            "Seleccione una familia por punto sin anfitrion "
            "(OneLevelBased)."
        )

    hoja, filas = leer_excel(ruta, nombre_hoja)

    if not filas:
        raise ValueError("La hoja esta vacia.")

    encabezados = {}

    for columna, valor in filas[0][1].items():
        titulo = str(valor).strip().upper()

        if titulo in ("ESTE", "NORTE", "COTA", "ID"):
            if titulo in encabezados:
                raise ValueError(
                    "Encabezado repetido: " + titulo
                )
            encabezados[titulo] = columna

    if all(
        titulo in encabezados
        for titulo in ("ESTE", "NORTE", "COTA")
    ):
        datos = filas[1:]
        formato = "Con encabezados ESTE, NORTE, COTA"

    else:
        try:
            for columna in ("A", "B", "C"):
                numero(filas[0][1].get(columna, ""))

        except Exception:
            raise ValueError(
                "Use encabezados ESTE, NORTE, COTA "
                "o datos numericos sin encabezados "
                "en A=Este, B=Norte, C=Cota."
            )

        encabezados = {
            "ESTE": "A",
            "NORTE": "B",
            "COTA": "C"
        }
        datos = filas
        formato = "Sin encabezados: A=Este, B=Norte, C=Cota"

    # Transformacion de coordenadas compartidas a internas.
    ubicacion = doc.ActiveProjectLocation

    origen = ubicacion.GetProjectPosition(XYZ(0, 0, 0))
    eje_x = ubicacion.GetProjectPosition(XYZ(1, 0, 0))
    eje_y = ubicacion.GetProjectPosition(XYZ(0, 1, 0))
    eje_z = ubicacion.GetProjectPosition(XYZ(0, 0, 1))

    a = eje_x.EastWest - origen.EastWest
    b = eje_y.EastWest - origen.EastWest
    c = eje_x.NorthSouth - origen.NorthSouth
    d = eje_y.NorthSouth - origen.NorthSouth

    determinante = a * d - b * c
    escala_z = eje_z.Elevation - origen.Elevation

    if (
        abs(determinante) < 1e-9
        or abs(escala_z) < 1e-9
    ):
        raise ValueError(
            "No se pudo invertir la transformacion "
            "de coordenadas compartidas."
        )

    puntos = []
    errores = []

    for fila, celdas in datos:
        try:
            coordenadas = [
                numero(celdas.get(encabezados[titulo], ""))
                for titulo in ("ESTE", "NORTE", "COTA")
            ]

            este, norte, cota = [
                a_internas(valor)
                for valor in coordenadas
            ]

            de = este - origen.EastWest
            dn = norte - origen.NorthSouth

            punto = XYZ(
                (de * d - b * dn) / determinante,
                (a * dn - de * c) / determinante,
                (cota - origen.Elevation) / escala_z
            )

            if not XYZ.IsWithinLengthLimits(punto):
                raise ValueError(
                    "Punto fuera de los limites internos de Revit. "
                    "Revise el Excel y las coordenadas compartidas. "
                    "XYZ interno en metros: "
                    "{:.3f}, {:.3f}, {:.3f}".format(
                        a_metros(punto.X),
                        a_metros(punto.Y),
                        a_metros(punto.Z)
                    )
                )

            identificador = (
                celdas.get(encabezados["ID"], "")
                if "ID" in encabezados else ""
            )

            puntos.append((
                fila, identificador, coordenadas, punto
            ))

        except Exception as error:
            errores.append(
                "Fila {}: {}".format(fila, error)
            )

    if errores:
        return {
            "Estado": "Validacion fallida; sin cambios",
            "Archivo": ruta,
            "Hoja": hoja,
            "Errores": errores
        }

    if not puntos:
        raise ValueError("No hay filas de coordenadas.")

    # Duplicados del mismo tipo dentro de 1 mm.
    tolerancia = a_internas(0.001)

    existentes = [
        instancia.Location.Point
        for instancia in (
            FilteredElementCollector(doc).OfClass(FamilyInstance)
        )
        if (
            instancia.GetTypeId().Equals(familia.Id)
            and isinstance(instancia.Location, LocationPoint)
        )
    ]

    pendientes = []
    omitidos = []

    for registro in puntos:
        if any(
            registro[3].DistanceTo(p) <= tolerancia
            for p in existentes
        ):
            omitidos.append(registro[0])
        else:
            pendientes.append(registro)
            existentes.append(registro[3])

    informe = {
        "Archivo": ruta,
        "Hoja": hoja,
        "Formato": formato,
        "Filas validas": len(puntos),
        "Por colocar": len(pendientes),
        "Filas omitidas por duplicado (1 mm)": omitidos,
        "Vista previa [fila, ID, Este, Norte, Cota]": [
            [fila, identificador] + coordenadas
            for fila, identificador, coordenadas, punto in puntos
        ]
    }

    if not colocar:
        informe["Estado"] = (
            "Coordenadas validadas; active EJECUTAR para colocar"
        )
        informe["Creadas"] = 0
        return informe

    if not pendientes:
        informe["Estado"] = "Sin puntos nuevos"
        informe["Creadas"] = 0
        return informe

    gestor = TransactionManager.Instance
    gestor.EnsureInTransaction(doc)

    subtransaccion = SubTransaction(doc)
    creadas = []
    comprobaciones = []

    try:
        subtransaccion.Start()

        if not familia.IsActive:
            familia.Activate()
            doc.Regenerate()

        for fila, identificador, coordenadas, punto in pendientes:
            instancia = doc.Create.NewFamilyInstance(
                punto,
                familia,
                StructuralType.NonStructural
            )

            doc.Regenerate()

            if not isinstance(
                instancia.Location, LocationPoint
            ):
                raise ValueError(
                    "Instancia sin ubicacion por punto. "
                    "Fila {}.".format(fila)
                )

            posicion = ubicacion.GetProjectPosition(
                instancia.Location.Point
            )

            reales = [
                a_metros(valor)
                for valor in (
                    posicion.EastWest,
                    posicion.NorthSouth,
                    posicion.Elevation
                )
            ]

            if any(
                abs(real - solicitado) > 0.001
                for real, solicitado in zip(reales, coordenadas)
            ):
                raise ValueError(
                    "Desviacion mayor a 1 mm. Fila {}. "
                    "Se revierte el lote.".format(fila)
                )

            creadas.append(instancia)
            comprobaciones.append(
                [fila, identificador] + reales
            )

        if (
            subtransaccion.Commit()
            != TransactionStatus.Committed
        ):
            raise ValueError(
                "Revit no confirmo la colocacion del lote."
            )

    except:
        if (
            subtransaccion.GetStatus()
            == TransactionStatus.Started
        ):
            subtransaccion.RollBack()
        raise

    finally:
        try:
            subtransaccion.Dispose()
        finally:
            gestor.TransactionTaskDone()

    informe.update({
        "Estado": "Colocacion completada correctamente",
        "Creadas": len(creadas),
        "Instancias": [
            instancia.ToDSType(True)
            for instancia in creadas
        ],
        "Coordenadas verificadas": comprobaciones
    })

    return informe


# Resultado para Watch y Dynamo Player.
try:
    OUT = ejecutar()

except Exception as error:
    OUT = {
        "Estado": "Error durante el proceso",
        "Detalle": str(error)
    }


# Ventana final: utiliza el metodo que ya funciono en Revit.
# No muestra avisos internos de formato.
try:
    estado = str(OUT.get("Estado", "Resultado"))
    resumen = []

    if "Filas validas" in OUT:
        resumen.append(
            "Puntos validos: {}\n"
            "Familias creadas: {}\n"
            "Duplicados omitidos: {}".format(
                OUT["Filas validas"],
                OUT.get("Creadas", 0),
                len(
                    OUT.get(
                        "Filas omitidas por duplicado (1 mm)",
                        []
                    )
                )
            )
        )

        if "VALIDADAS" in estado.upper():
            resumen.append(
                "No se realizaron cambios en el modelo.\n"
                "Puntos por colocar: {}\n"
                "Active EJECUTAR para colocar las familias.".format(
                    OUT.get("Por colocar", 0)
                )
            )

    if "Detalle" in OUT:
        resumen.append(str(OUT["Detalle"]))

    if OUT.get("Errores"):
        resumen.append(
            "Errores detectados:\n" + "\n".join(
                str(error)
                for error in OUT["Errores"][:10]
            )
        )

        if len(OUT["Errores"]) > 10:
            resumen.append(
                "Consulte OUT para ver todos los errores."
            )

    if "Archivo" in OUT:
        nombre_archivo = (
            str(OUT["Archivo"])
            .replace("\\", "/")
            .rsplit("/", 1)[-1]
        )
        resumen.append("Archivo: " + nombre_archivo)

    if "Hoja" in OUT:
        resumen.append("Hoja: " + str(OUT["Hoja"]))

    resumen.append(
        "Grupo 3: Dilver Llajaruna, "
        "Jimmy Loli, Ingelver Gonzales"
    )

    mensaje = estado + "\n\n" + "\n\n".join(resumen)

    TaskDialog.Show(
        "Puntos de control | Excel",
        mensaje
    )

except Exception as error_ventana:
    OUT["Aviso ventana"] = str(error_ventana)
# ----------------------------------------
watch = Watch(python_script)  # graph output
